# Grasshopper definition dev_gh_testFile.gh (Grasshopper 1.0.7)

script_get_block = FilePath("/Users/benny/Documents/Project/SKEMA/get_block.py")
file = ReadFile(File=script_get_block, PerLineParse=False)

python = GhPythonScript(Code=file)  # -> Out, Id_, Location_

# ---- group: import script:
script_opening = FilePath("/Users/benny/Documents/Project/SKEMA/opening.py")
file_2 = ReadFile(File=script_opening, PerLineParse=False)

# ----
aperture = Slider(0.65, range=0.05..0.95)
python_2 = GhPythonScript(Code=file_2, _id=python.Id_, _location=python.Location_, _opening_ratio=aperture, _flip=Slider(2, range=0..3))  # -> Out, OpeningType_, OpeningFrame_, OpeningPanel_, Opening2D_, Opening3D_, OpeningInWall_, Aperture_
wires = BrepWireframe(Brep=python_2.Aperture_, Density=-1)
geo = Geometry(python_2.Opening3D_)
geo_2 = Geometry(python_2.Opening2D_)

script_wall_host = FilePath("/Users/benny/Documents/Project/SKEMA/wall_hole.py")
file_3 = ReadFile(File=script_wall_host, PerLineParse=False)

script_wall = FilePath("/Users/benny/Documents/Project/SKEMA/wall.py")
file_4 = ReadFile(File=script_wall, PerLineParse=False)

hole_srf = Surface(python_2.OpeningInWall_)
wall_crv = Curve([<curve referenced from the Rhino model> x6])
python_3 = GhPythonScript(Code=file_4, _input=wall_crv, _id="wA", _level="L1", _height=Slider(4, range=0..10))  # -> Out, Identifier_, Length_, Area_, Wall_
wall_srf = Surface(python_3.Wall_)
python_4 = GhPythonScript(Code=file_3, Wall_srfs=flatten(wall_srf), Opening_srfs=flatten(hole_srf))  # -> Out, Host_set, Wall_fixed
panel = Panel(python_3.Length_)
panel_2 = Panel(python_3.Wall_)
panel_3 = Panel(python_3.Out)
brep = Brep(python_4.Wall_fixed)
panel_4 = Panel(python_4.Out)
